# Grasshopper definition CubeSubdiv.ghx (Grasshopper 1.0.4)

crv = Curve()
brep = Brep()
c_script = CSharpScript(
    Cube=brep,
    Crv=crv,
    Seed=Slider(50, range=0..100),
    SubdivDist=Slider(4.5, range=0..1000),
    SubdivRandomRate=Slider(0.5, range=0..1),
    ReduceDist=Slider(0.6, range=0..10),
    ReduceRandomRate=Slider(0.5, range=0..1),
    Loops=Slider(3, range=0..10))  # -> out, result; inputs Cube: Brep, Crv: Curve, Seed: Int32, SubdivDist: Double, SubdivRandomRate: Double, ReduceDist: Double, ReduceRandomRate: Double, Loops: Int32
# ---------- c_script: C# ----------
    //System.Diagnostics.Stopwatch stopWatch = new System.Diagnostics.Stopwatch();
    Random random = new Random();
    double maxVolume = BrepVolume(Cube);
    List<Brep> curCubes = DivideCube(Cube);
    List<Brep> newCubes = new List<Brep>();
    for(int i = 0; i < Loops; i++){
      //stopWatch.Start();
      if(i != 0){
        curCubes = new List<Brep>(newCubes);
      }
      newCubes.Clear();
      foreach(Rhino.Geometry.Brep cube in curCubes){
        double dist = distBrepCrv(cube, Crv);
        dist *= (random.NextDouble() * SubdivRandomRate) + (1 - SubdivRandomRate);
        if(dist < SubdivDist){
          newCubes.AddRange(DivideCube(cube));
        } else{
          newCubes.Add(cube);
        }
      }
      //stopWatch.Stop();
      //Print("Step 1 RunTime " + stopWatch.ElapsedMilliseconds.ToString());
      //stopWatch.Restart();
      List<Brep> reducedCubes = new List<Brep>();
      foreach(Rhino.Geometry.Brep cube in newCubes){
        double dist = distBrepCrv(cube, Crv);
        dist *= (random.NextDouble() * ReduceRandomRate) + (1 - ReduceRandomRate);
        dist *= System.Math.Pow((BrepVolume(cube) / maxVolume), 0.2);
        if(dist > ReduceDist){
          reducedCubes.Add(cube);
        }
      }
      newCubes = reducedCubes;
      //stopWatch.Stop();
      //Print("Step 2 RunTime " + stopWatch.ElapsedMilliseconds.ToString());
    }

    result = newCubes;
# ---------- c_script: C# additional code ----------
  double distBrepCrv(Brep x, Curve Crv){
    double t;
    Crv.ClosestPoint(BrepCentroid(x), out t);
    Point3d ptOnCrv = Crv.PointAt(t);
    return ptOnCrv.DistanceTo(BrepCentroid(x));
  }

  double BrepVolume(Brep x){
    return Rhino.Geometry.VolumeMassProperties.Compute(x).Volume;
  }

  Point3d BrepCentroid(Brep x){
    return Rhino.Geometry.VolumeMassProperties.Compute(x).Centroid;
  }

  NurbsSurface Srf3Pt(Point3d A, Point3d B, Point3d C){
    Point3d D = new Point3d(0, 0, 0);
    D = Point3d.Add(D, (B + C - A));
    NurbsSurface srf = NurbsSurface.CreateFromCorners(A, B, D, C);
    return srf;
  }

  Brep Cube4Pt(Point3d A, Point3d B, Point3d C, Point3d D){
    List<Brep> srfs = new List<Brep>();

    Point3d E = new Point3d(0, 0, 0);
    Point3d F = new Point3d(0, 0, 0);
    Point3d G = new Point3d(0, 0, 0);

    E = Point3d.Add(E, (B + C - A));
    F = Point3d.Add(F, (B + D - A));
    G = Point3d.Add(G, (C + D - A));

    srfs.Add(Brep.TryConvertBrep(Srf3Pt(A, B, C)));
    srfs.Add(Brep.TryConvertBrep(Srf3Pt(A, B, D)));
    srfs.Add(Brep.TryConvertBrep(Srf3Pt(A, C, D)));
    srfs.Add(Brep.TryConvertBrep(Srf3Pt(D, F, G)));
    srfs.Add(Brep.TryConvertBrep(Srf3Pt(B, F, E)));
    srfs.Add(Brep.TryConvertBrep(Srf3Pt(C, E, G)));

    Brep[] Brs = Brep.JoinBreps(srfs, 0.01);
    return Brs[0];
  }

  List<Brep> DivideCube(Brep Cube){
    List<Brep> newCubes = new List<Brep>();
    int n = Cube.Vertices.Count();
    for (int i = 0; i < n; i++){
      int[] edgeIndexs = Cube.Vertices[i].EdgeIndices();
      int n1 = edgeIndexs.Length;
      List<Point3d> midPoints = new List<Point3d>();
      for (int j = 0; j < n1; j++){
        midPoints.Add(Cube.Edges[edgeIndexs[j]].PointAtNormalizedLength(0.5));
      }
      newCubes.Add(Cube4Pt(Cube.Vertices[i].Location, midPoints[0], midPoints[1], midPoints[2]));
    }
    return newCubes;
  }
# ---------- end c_script ----------
brep_2 = Brep(c_script.result)
volume = Volume(Geometry=brep_2)  # -> Volume, Centroid
crv_cp = CurveClosestPoint(Point=volume.Centroid, Curve=crv)  # -> Point, Parameter, Distance
bnd = Bounds(Numbers=flatten(crv_cp.Distance))
remap = RemapNumbers(Value=crv_cp.Distance, Source=bnd, Target=Domain(0, 1))  # -> Mapped, Clipped
gradient = Gradient(LowerLimit=0, UpperLimit=1, Parameter=remap.Mapped, stops=[0.111: RGB(255, 120, 165), 0.47: RGB(102, 214, 255)])
preview = CustomPreview(Geometry=brep_2, Shader=gradient)
